# Grasshopper definition engine_mount.gh (Grasshopper 1.0.8)

pt = Point(<point referenced from the Rhino model>)
pdecon = Deconstruct(Point=pt)  # -> XComponent, YComponent, ZComponent
cir = Circle(Plane=pt, Radius="1.5")
cir_2 = Circle(Plane=pt, Radius="1.6")
pdecon_2 = Deconstruct(Point=pt)  # -> XComponent, YComponent, ZComponent
addition = Addition(A=pdecon_2.ZComponent, B=".0625")
addition_2 = Addition(A=pdecon.ZComponent, B=".0625")
subtraction = Subtraction(A=pdecon_2.YComponent, B="0.2998543")
pt_2 = ConstructPoint(XCoordinate=pdecon_2.XComponent, YCoordinate=subtraction, ZCoordinate=addition)
pt_3 = ConstructPoint(XCoordinate=pdecon.XComponent, YCoordinate=pdecon.YComponent, ZCoordinate=addition_2)
cir_3 = Circle(Plane=pt_3, Radius="1.5")
cir_4 = Circle(Plane=pt_3, Radius="1.6")
pdecon_3 = Deconstruct(Point=pt_2)  # -> XComponent, YComponent, ZComponent
pdecon_4 = Deconstruct(Point=pt_3)  # -> XComponent, YComponent, ZComponent
cir_5 = Circle(Plane=pt_2, Radius=".6")
cir_6 = Circle(Plane=pt_2, Radius=".96/2")
addition_3 = Addition(A=pdecon_3.ZComponent, B=".0625")
addition_4 = Addition(A=pdecon_4.ZComponent, B="1.154")
pt_4 = ConstructPoint(XCoordinate=pdecon_3.XComponent, YCoordinate=pdecon_3.YComponent, ZCoordinate=addition_3)
cir_7 = Circle(Plane=pt_4, Radius=".952/2")
boundary = BoundarySurfaces(Edges=[cir_5, cir_6])
vec = VectorXYZ(XComponent=0, YComponent=0, ZComponent=".0625")  # -> Vector, Length
pt_5 = ConstructPoint(XCoordinate=pdecon_4.XComponent, YCoordinate=pdecon_4.YComponent, ZCoordinate=addition_4)
cir_8 = Circle(Plane=pt_4, Radius=".6")
addition_5 = Addition(A=addition_4, B=".0625/2")
boundary_2 = BoundarySurfaces(Edges=cir)
loft = Loft(Curves=[cir, cir_3], Options={Adjust=False, Closed=False, LoftEnds=0, LoftSimp=0, LoftType=0, Rebuild=10, Refit=0.01})
pdecon_5 = Deconstruct(Point=pt_5)  # -> XComponent, YComponent, ZComponent
boundary_3 = BoundarySurfaces(Edges=cir_3)
dom = ConstructDomain(DomainStart="-0.0984252", DomainEnd="0.0984252")
addition_6 = Addition(A=pdecon_5.XComponent, B="-.08")
cir_9 = Circle(Plane=pt_5, Radius=".1")
addition_7 = Addition(A=pdecon_5.XComponent, B=".08")
pt_6 = ConstructPoint(XCoordinate=addition_6, YCoordinate=pdecon_5.YComponent, ZCoordinate=pdecon_5.ZComponent)
pt_7 = ConstructPoint(XCoordinate=addition_7, YCoordinate=pdecon_5.YComponent, ZCoordinate=pdecon_5.ZComponent)
pt_8 = ConstructPoint(XCoordinate=pdecon_4.XComponent, YCoordinate=pdecon_4.YComponent, ZCoordinate=addition_5)
rectangle = Rectangle(Plane=pt_6, XSize="-.08", YSize=dom, Radius=0)  # -> Rectangle, Length
rectangle_2 = Rectangle(Plane=pt_7, XSize=".08", YSize=dom, Radius=0)  # -> Rectangle, Length
rdiff = RegionDifference(CurvesA=cir_9, CurvesB=[rectangle_2.Rectangle, rectangle.Rectangle])
cir_10 = Circle(Plane=pt_5, Radius="1.4")
cir_11 = Circle(Plane=pt_5, Radius="1.5")
cir_12 = Circle(Plane=pt_5, Radius="0.1968504")
cir_13 = Circle(Plane=pt_3, Radius="1.4")
boundary_4 = BoundarySurfaces(Edges=[cir_10, cir_11])
cir_14 = Circle(Plane=pt_8, Radius="0.1968504")
rdiff_2 = RegionDifference(CurvesA=cir_12, CurvesB=rdiff)
cir_15 = Circle(Plane=pt_8, Radius="1.4")
boundary_5 = BoundarySurfaces(Edges=rdiff_2)
divide = DivideCurve(Curve=cir_14, Count="4", Kinks=False)  # -> Points, Tangents, Parameters
divide_2 = DivideCurve(Curve=cir_15, Count="4", Kinks=False)  # -> Points, Tangents, Parameters
divide_3 = DivideCurve(Curve=cir_5, Count="4", Kinks=False)  # -> Points, Tangents, Parameters
divide_4 = DivideCurve(Curve=cir_13, Count="4", Kinks=False)  # -> Points, Tangents, Parameters
ln = Line(StartPoint=divide.Points, EndPoint=divide_2.Points)
extr = Extrude(Base=boundary, Direction=vec.Vector)
pipe = Pipe(Curve=ln, Radius=".0625/2", Caps=2)  # -> flatten(Pipe)
extr_2 = Extrude(Base=boundary_4, Direction=vec.Vector)
bvol = BoundaryVolume(Boundaries=[boundary_2, loft, boundary_3])
extr_3 = Extrude(Base=boundary_5, Direction=vec.Vector)  # -> flatten(Extrusion)
ln_2 = Line(StartPoint=divide_3.Points, EndPoint=divide_4.Points)
pipe_2 = Pipe(Curve=ln_2, Radius=".0625/2", Caps=1)  # -> flatten(Pipe)
sunion = SolidUnion(Breps=[pipe, extr_2, extr_3])
sunion_2 = SolidUnion(Breps=[extr, pipe_2, bvol])
