# Grasshopper definition moire_cylinder_v1.gh (Grasshopper 1.0.8)

# ---- group: UserInputs
innercirclediameter = Slider(3, range=1..6)
innercirclewidth = Slider(0.25, range=0.125..2)
outercirclewdith = Slider(0.25, range=0.125..2)
height = Slider(0.5, range=0.063..0.5)
innerspokecount = Slider(10, range=0..50)
outerspokecount = Slider(25, range=0..50)
height_2 = Slider(5, range=1..9)
innerspokewavect = Slider(10, range=0..30)
outerspokewavect = Slider(10, range=0..30)
innerstartingdirection = Slider(0, range=0..1)
inneramp = Slider(1, range=0..5)
outerstartingdirection = Slider(0, range=0..1)
outeramp = Slider(2.1, range=0..5)

# ---- group: InnerOuterStructure
# First Disk
# Don't Touch
# Inner & Outer Walls
pt = Point(<point referenced from the Rhino model>)
panel = Panel("4.25")
cir = Circle(Plane=pt, Radius=".05")
cir_2 = Circle(Plane=pt, Radius=".25")
cir_3 = Circle(Plane=pt, Radius="4")
cir_4 = Circle(Plane=pt, Radius=panel)
boundary = BoundarySurfaces(Edges=[cir, cir_2])
boundary_2 = BoundarySurfaces(Edges=[cir_3, cir_4])
panel_2 = Panel(".25")
Z = UnitZ(Factor=".5")
Z_2 = UnitZ(Factor=panel_2)
extr = Extrude(Base=boundary, Direction=Z)
extr_2 = Extrude(Base=boundary_2, Direction=Z_2)

# ---- group: Spokes / Inputs
numberofspokes = Slider(45, range=0..50)
curvepoints = Slider(5, range=0..12)
startingdirection = Slider(1, range=0..1)
number_slider = Slider(1, range=1..2)
curvecomplexity = Slider(3, range=1..5)

numberofspokes_2 = Slider(35, range=0..50)
curvepoints_2 = Slider(8, range=0..12)
startingdirection_2 = Slider(1, range=0..1)
number_slider_2 = Slider(1, range=1..2)
curvecomplexity_2 = Slider(4, range=1..5)

# ----
expression = Expression(x=panel, Expression="(x*2) + 1")

# ---- group: BaseRings
pt_2 = Point(<point referenced from the Rhino model>)
pdecon = Deconstruct(Point=pt_2)  # -> XComponent, YComponent, ZComponent
addition = Addition(A=pdecon.ZComponent, B=height)
pt_3 = ConstructPoint(XCoordinate=pdecon.XComponent, YCoordinate=pdecon.YComponent, ZCoordinate=addition)

# ---- group: BaseRings / InnerCircleBottom
division = Division(A=innercirclediameter, B="2")
addition_2 = Addition(A=division, B=innercirclewidth)
innerinnerbottom = Circle(Plane=pt_2, Radius=division)
innerouterbottom = Circle(Plane=pt_2, Radius=addition_2)

# ---- group: BaseRings / OuterCircleBottom
clearance = Panel("0.015625")
addition_3 = Addition(A=addition_2, B=clearance)
addition_4 = Addition(A=addition_3, B=outercirclewdith)
cir_5 = Circle(Plane=pt_2, Radius=addition_3)
cir_6 = Circle(Plane=pt_2, Radius=addition_4)

# ---- group: Spokes / BaseCurves
divide = DivideCurve(Curve=cir_2, Count=numberofspokes, Kinks=False)  # -> Points, Tangents, Parameters
divide_2 = DivideCurve(Curve=cir_3, Count=numberofspokes, Kinks=False)  # -> Points, Tangents, Parameters

# ---- group: Spokes / AdjustedStartingPts
expression_2 = Expression(x=panel_2, Expression="x/2")
expression_3 = Expression(x=panel_2, Expression="x/2")
pdecon_2 = Deconstruct(Point=divide.Points)  # -> XComponent, YComponent, ZComponent
pdecon_3 = Deconstruct(Point=divide_2.Points)  # -> XComponent, YComponent, ZComponent
addition_5 = Addition(A=pdecon_2.ZComponent, B=expression_2)
addition_6 = Addition(A=pdecon_3.ZComponent, B=expression_3)
pt_4 = ConstructPoint(XCoordinate=pdecon_2.XComponent, YCoordinate=pdecon_2.YComponent, ZCoordinate=addition_5)
pt_5 = ConstructPoint(XCoordinate=pdecon_3.XComponent, YCoordinate=pdecon_3.YComponent, ZCoordinate=addition_6)

# ---- group: BaseRings / InnerCircleTop
division_2 = Division(A=innercirclediameter, B="2")
addition_7 = Addition(A=division_2, B=innercirclewidth)
innerinnertop = Circle(Plane=pt_3, Radius=division_2)
inneroutertop = Circle(Plane=pt_3, Radius=addition_7)

# ---- group: BaseRings / OuterCircleTop
addition_8 = Addition(A=addition_7, B=clearance)
addition_9 = Addition(A=addition_8, B=outercirclewdith)
cir_7 = Circle(Plane=pt_3, Radius=addition_8)
cir_8 = Circle(Plane=pt_3, Radius=addition_9)

# ---- group: Spokes / ZigZagSeries
series = Series(Start=startingdirection_2, Step=number_slider_2, Count=curvepoints_2)
expression_4 = Expression(x=series, Expression="(-1)^x")
replace = ReplaceItems(List=expression_4, Item="0", Indices="0", Wrap=False)

# ---- group: BaseRings / InnerRingNotchCircle
division_3 = Division(A=addition, B="2")
expression_5 = Expression(x=addition_7, y=clearance, z=outercirclewdith, Expression="x + ((y + z)/2)")
pt_6 = ConstructPoint(XCoordinate=pdecon.XComponent, YCoordinate=pdecon.YComponent, ZCoordinate=division_3)
inneroutertop_2 = Circle(Plane=pt_6, Radius=expression_5)

# ---- group: Spokes / ZigZagSeries
series_2 = Series(Start=startingdirection, Step=number_slider, Count=curvepoints)
expression_6 = Expression(x=series_2, Expression="(-1)^x")
replace_2 = ReplaceItems(List=expression_6, Item="0", Indices="0", Wrap=False)

# ---- group: Spokes / MainSpokes
ln = Line(StartPoint=pt_4, EndPoint=pt_5)
divide_3 = DivideCurve(Curve=ln, Count=curvepoints, Kinks=False)  # -> Points, Tangents, Parameters

# ---- group: BaseRings / OuterRingNotchCircle
addition_10 = Addition(A=expression_5, B=clearance)
inneroutertop_3 = Circle(Plane=pt_6, Radius=addition_10)

# ---- group: BaseRings / InnerRing
loft_opt = LoftOptions(Closed=Toggle(True), Adjust=False, Rebuild=0, Refit=0, Type="3")
innerringfinal = Loft(Curves=[inneroutertop, innerinnertop, innerinnerbottom, innerouterbottom, inneroutertop_2], Options=loft_opt)

# ---- group: BaseRings / OuterRing
loft_opt_2 = LoftOptions(Closed=Toggle(True), Adjust=False, Rebuild=0, Refit=0, Type="3")
outerringfinal = Loft(Curves=[cir_5, cir_6, cir_8, cir_7, inneroutertop_3], Options=loft_opt_2)

# ---- group: Spokes / CurveOffset
expression_7 = Expression(Expression="π/2")
Z_3 = UnitZ(Factor=1)
vrot = Rotate(Vector=divide_3.Tangents, Axis=Z_3, Angle=expression_7)
amp = Amplitude(Vector=vrot, Amplitude=replace_2)
move = Move(Geometry=divide_3.Points, Motion=amp)  # -> Geometry, Transform
nurbs = NurbsCurve(Vertices=move.Geometry, Degree=curvecomplexity, Periodic=False)  # -> Curve, Length, Domain

# ----
panel_3 = Panel(replace)

# ---- group: BaseRings / AddFillet
number_slider_3 = Slider(0.25, range=0..1)
debrep = DeconstructBrep(Brep=innerringfinal)  # -> Faces, Edges, Vertices
debrep_2 = DeconstructBrep(Brep=outerringfinal)  # -> Faces, Edges, Vertices
filedge = FilletEdge(Shape=innerringfinal, Blend=0, Metric=0, Edges="9", Radii=number_slider_3)
filedge_2 = FilletEdge(Shape=outerringfinal, Blend=0, Metric=0, Edges="9", Radii=number_slider_3)
panel_4 = Panel(debrep_2.Edges)

# ---- group: HeightPointAdjustment
pdecon_4 = Deconstruct(Point=pt_3)  # -> XComponent, YComponent, ZComponent
addition_11 = Addition(A=pdecon_4.ZComponent, B=height_2)
pt_7 = ConstructPoint(XCoordinate=pdecon_4.XComponent, YCoordinate=pdecon_4.YComponent, ZCoordinate=addition_11)

# ----
expression_8 = Expression(Expression="π/2")
expression_9 = Expression(Expression="π/2")
Z_4 = UnitZ(Factor=1)
Z_5 = UnitZ(Factor=1)

# ---- group: Spokes / FinalSweep
eval = EvaluateCurve(Curve=nurbs.Curve, Parameter="0")  # -> Point, Tangent, Angle
expression_10 = Expression(x=panel_2, Expression="-x/4")
expression_11 = Expression(x=panel_2, Expression="-x/2")
expression_12 = Expression(x=panel_2, Expression="x/4")
expression_13 = Expression(x=panel_2, Expression="x/2")
pl = PlaneNormal(Origin=eval.Point, ZAxis=eval.Tangent)
dom = ConstructDomain(DomainStart=expression_11, DomainEnd=expression_13)
dom_2 = ConstructDomain(DomainStart=expression_10, DomainEnd=expression_12)
rectangle = Rectangle(Plane=pl, XSize=dom_2, YSize=dom, Radius=0)  # -> Rectangle, Length
graft = GraftTree(Tree=rectangle.Rectangle, IncludeEmptyLists=True, IncludeNullItems=True)
swp1 = Sweep1(Rail=nurbs.Curve, Sections=graft, Miter=1)
cap = CapHoles(Brep=swp1)

# ---- group: OuterRingPts
darc = DeconstructArc(Arc=cir_7)  # -> BasePlane, Radius, Angle
darc_2 = DeconstructArc(Arc=cir_8)  # -> BasePlane, Radius, Angle
avr = Average(Input=[darc.Radius, darc_2.Radius])
cir_9 = Circle(Plane=pt_3, Radius=avr)
cir_10 = Circle(Plane=pt_7, Radius=avr)
divide_4 = DivideCurve(Curve=cir_9, Count=outerspokecount, Kinks=False)  # -> Points, Tangents, Parameters
divide_5 = DivideCurve(Curve=cir_10, Count=outerspokecount, Kinks=False)  # -> Points, Tangents, Parameters

# ----
rad = Radians(Degrees=Slider(0, range=0..360))

# ---- group: Spokes
# FinalBrep
# Only Adjust the Above Values
sunion = SolidUnion(Breps=[extr, extr_2, cap])

# ---- group: InnerOuterStructure
# Second Disk
# Don't Touch
# Inner & Outer Walls
pt_8 = Point(<point referenced from the Rhino model>)
panel_5 = Panel(".25")
Z_6 = UnitZ(Factor=".5")
Z_7 = UnitZ(Factor=panel_5)

# ----
pdecon_5 = Deconstruct(Point=pt_8)  # -> XComponent, YComponent, ZComponent
pt_9 = ConstructPoint(XCoordinate=expression, YCoordinate=pdecon_5.YComponent, ZCoordinate=pdecon_5.ZComponent)

# ---- group: InnerOuterStructure (continued)
cir_11 = Circle(Plane=pt_9, Radius=".05")
cir_12 = Circle(Plane=pt_9, Radius=".25")
cir_13 = Circle(Plane=pt_9, Radius="4")
cir_14 = Circle(Plane=pt_9, Radius="4.25")
boundary_3 = BoundarySurfaces(Edges=[cir_11, cir_12])
boundary_4 = BoundarySurfaces(Edges=[cir_13, cir_14])
extr_3 = Extrude(Base=boundary_3, Direction=Z_6)
extr_4 = Extrude(Base=boundary_4, Direction=Z_7)

# ---- group: Spokes / BaseCurves
divide_6 = DivideCurve(Curve=cir_12, Count=numberofspokes_2, Kinks=False)  # -> Points, Tangents, Parameters
divide_7 = DivideCurve(Curve=cir_13, Count=numberofspokes_2, Kinks=False)  # -> Points, Tangents, Parameters

# ---- group: Spokes / AdjustedStartingPts
expression_14 = Expression(x=panel_5, Expression="x/2")
expression_15 = Expression(x=panel_5, Expression="x/2")
pdecon_6 = Deconstruct(Point=divide_6.Points)  # -> XComponent, YComponent, ZComponent
pdecon_7 = Deconstruct(Point=divide_7.Points)  # -> XComponent, YComponent, ZComponent
addition_12 = Addition(A=pdecon_6.ZComponent, B=expression_14)
addition_13 = Addition(A=pdecon_7.ZComponent, B=expression_15)
pt_10 = ConstructPoint(XCoordinate=pdecon_6.XComponent, YCoordinate=pdecon_6.YComponent, ZCoordinate=addition_12)
pt_11 = ConstructPoint(XCoordinate=pdecon_7.XComponent, YCoordinate=pdecon_7.YComponent, ZCoordinate=addition_13)

# ---- group: Spokes / MainSpokes
ln_2 = Line(StartPoint=pt_10, EndPoint=pt_11)
divide_8 = DivideCurve(Curve=ln_2, Count=curvepoints_2, Kinks=False)  # -> Points, Tangents, Parameters

# ---- group: Spokes / CurveOffset
expression_16 = Expression(Expression="π/2")
Z_8 = UnitZ(Factor=1)
vrot_2 = Rotate(Vector=divide_8.Tangents, Axis=Z_8, Angle=expression_16)
amp_2 = Amplitude(Vector=vrot_2, Amplitude=replace)
move_2 = Move(Geometry=divide_8.Points, Motion=amp_2)  # -> Geometry, Transform
nurbs_2 = NurbsCurve(Vertices=move_2.Geometry, Degree=curvecomplexity_2, Periodic=False)  # -> Curve, Length, Domain

# ---- group: Spokes / FinalSweep
eval_2 = EvaluateCurve(Curve=nurbs_2.Curve, Parameter="0")  # -> Point, Tangent, Angle
expression_17 = Expression(x=panel_5, Expression="-x/2")
expression_18 = Expression(x=panel_5, Expression="-x/4")
expression_19 = Expression(x=panel_5, Expression="x/2")
expression_20 = Expression(x=panel_5, Expression="x/4")
pl_2 = PlaneNormal(Origin=eval_2.Point, ZAxis=eval_2.Tangent)
dom_3 = ConstructDomain(DomainStart=expression_17, DomainEnd=expression_19)
dom_4 = ConstructDomain(DomainStart=expression_18, DomainEnd=expression_20)
rectangle_2 = Rectangle(Plane=pl_2, XSize=dom_4, YSize=dom_3, Radius=0)  # -> Rectangle, Length
graft_2 = GraftTree(Tree=rectangle_2.Rectangle, IncludeEmptyLists=True, IncludeNullItems=True)
swp1_2 = Sweep1(Rail=nurbs_2.Curve, Sections=graft_2, Miter=1)
cap_2 = CapHoles(Brep=swp1_2)

# ---- group: Spokes
# FinalBrep
# Only Adjust the Above Values
sunion_2 = SolidUnion(Breps=[extr_3, extr_4, cap_2])

# ---- group: RotationMoirePreview
# <- Enable Preview
# Slide This to View the Rotation Preview ->
neg = Negative(Value=expression)
vec = VectorXYZ(XComponent=neg, YComponent=pdecon_5.YComponent, ZComponent=pdecon_5.ZComponent)  # -> Vector, Length
move_3 = Move(Geometry=sunion_2, Motion=vec.Vector)  # -> Geometry, Transform
expression_21 = Expression(Expression="1*π")
xz = XZPlane(Origin=Point(0, 0, 0))
rotate = Rotate(Geometry=move_3.Geometry, Angle=expression_21, Plane=xz)  # -> Geometry, Transform
rad_2 = Radians(Degrees=Slider(360, range=0..360))
rotate_2 = Rotate(Geometry=rotate.Geometry, Angle=rad_2, Plane=PlaneXY(0, 0, 0))  # -> Geometry, Transform

# ---- group: InnerRingsPts
darc_3 = DeconstructArc(Arc=innerinnertop)  # -> BasePlane, Radius, Angle
darc_4 = DeconstructArc(Arc=inneroutertop)  # -> BasePlane, Radius, Angle
avr_2 = Average(Input=[darc_3.Radius, darc_4.Radius])
cir_15 = Circle(Plane=pt_3, Radius=avr_2)
cir_16 = Circle(Plane=pt_7, Radius=avr_2)
divide_9 = DivideCurve(Curve=cir_15, Count=innerspokecount, Kinks=False)  # -> Points, Tangents, Parameters

# ----
vec2pt = Vector2Pt(PointA=pt_3, PointB=divide_9.Points, Unitize=False)  # -> Vector, Length
vrot_3 = Rotate(Vector=vec2pt.Vector, Axis=Z_5, Angle=expression_8)
rotate_3 = Rotate(Geometry=cir_16, Angle=rad, Plane=PlaneXY(0, 0, 0))  # -> Geometry, Transform

# ---- group: InnerRingsPts (continued)
divide_10 = DivideCurve(Curve=rotate_3.Geometry, Count=innerspokecount, Kinks=False)  # -> Points, Tangents, Parameters

# ----
vec2pt_2 = Vector2Pt(PointA=rotate_3.Geometry, PointB=divide_10.Points, Unitize=False)  # -> Vector, Length
vrot_4 = Rotate(Vector=vec2pt_2.Vector, Axis=Z_4, Angle=expression_9)
eval_3 = EvaluateCurve(Curve=cir_15, Parameter=divide_9.Parameters)  # -> Point, Tangent, Angle
eval_4 = EvaluateCurve(Curve=rotate_3.Geometry, Parameter=divide_10.Parameters)  # -> Point, Tangent, Angle
panel_6 = Panel(eval_3.Tangent)
bzspan = BezierSpan(StartPoint=divide_9.Points, StartTangent=eval_3.Tangent, EndPoint=divide_10.Points, EndTangent=eval_4.Tangent)  # -> Curve, Length, Domain

# ---- group: InnerZigZag
series_3 = Series(Start=innerstartingdirection, Step=1, Count=innerspokewavect)
expression_22 = Expression(x=series_3, Expression="(-1)^x")

# ----
multiplication = Multiplication(A=expression_22, B=inneramp)

# ---- group: InnerZigZag (continued)
replace_3 = ReplaceItems(List=multiplication, Item="0", Indices="0", Wrap=False)

# ----
series_4 = Series(Start=outerstartingdirection, Step=1, Count=outerspokewavect)
expression_23 = Expression(x=series_4, Expression="(-1)^x")

multiplication_2 = Multiplication(A=expression_23, B=outeramp)

replace_4 = ReplaceItems(List=multiplication_2, Item="0", Indices="0", Wrap=False)
