# Grasshopper definition moire_cylinder_v6.gh (Grasshopper 1.0.8)

# ---- group: UserInputs
spireheight = Slider(5.394, range=1..9)
innerspokecount = Slider(9, range=0..50)
innertwist = Slider(64, range=-360..360)
outerspokecount = Slider(7, range=0..50)
outertwist = Slider(-145, range=-360..360)

# ---- group: AdjustableIfNeeded
outerspokethickness = Slider(0.25, range=0..1)
innercirclediameter = Slider(3, range=1..6)
innercirclewidth = Slider(0.25, range=0.125..2)
outercirclewdith = Slider(0.25, range=0.125..2)
baseheight = Slider(1.25, range=0.063..1.25)
numberoftweencircles = Slider(8, range=1..10)
innerspokethickness = Slider(0.25, range=0..1)

# ---- group: BaseRings
pt = Point(<point referenced from the Rhino model>)
pdecon = Deconstruct(Point=pt)  # -> XComponent, YComponent, ZComponent
addition = Addition(A=pdecon.ZComponent, B=baseheight)
pt_2 = ConstructPoint(XCoordinate=pdecon.XComponent, YCoordinate=pdecon.YComponent, ZCoordinate=addition)

# ----
subtraction = Subtraction(A=pdecon.ZComponent, B="1.965")
subtraction_2 = Subtraction(A=pdecon.ZComponent, B="1.965")
addition_2 = Addition(A=subtraction_2, B=".635")
pt_3 = ConstructPoint(XCoordinate=pdecon.XComponent, YCoordinate=pdecon.YComponent, ZCoordinate=subtraction_2)
pt_4 = ConstructPoint(XCoordinate=pdecon.XComponent, YCoordinate=pdecon.YComponent, ZCoordinate=subtraction)
pt_5 = ConstructPoint(XCoordinate=pdecon.XComponent, YCoordinate=pdecon.YComponent, ZCoordinate=addition_2)
dom = ConstructDomain(DomainStart="-1.2", DomainEnd="1.2")
dom_2 = ConstructDomain(DomainStart="-.64", DomainEnd=".64")
dom_3 = ConstructDomain(DomainStart="-1.2", DomainEnd="1.2")
dom_4 = ConstructDomain(DomainStart="-.64", DomainEnd=".64")
expression = Expression(x=baseheight, Expression="x - 1")

# ---- group: BaseRings / InnerCircleBottom
division = Division(A=innercirclediameter, B="2")
addition_3 = Addition(A=division, B=innercirclewidth)
innerinnerbottom = Circle(Plane=pt, Radius=division)
innerouterbottom = Circle(Plane=pt, Radius=addition_3)

# ---- group: BaseRings / OuterCircleBottom
clearance = Panel("0.015625")
addition_4 = Addition(A=addition_3, B=clearance)
addition_5 = Addition(A=addition_4, B=outercirclewdith)
cir = Circle(Plane=pt, Radius=addition_5)
cir_2 = Circle(Plane=pt, Radius=addition_4)

# ----
cir_3 = Circle(Plane=pt_3, Radius=addition_5)
cir_4 = Circle(Plane=pt_4, Radius=addition_4)
rectangle = Rectangle(Plane=pt_5, XSize=dom_2, YSize=dom, Radius=0)  # -> Rectangle, Length
rectangle_2 = Rectangle(Plane=pt_3, XSize=dom_4, YSize=dom_3, Radius=0)  # -> Rectangle, Length
vec = VectorXYZ(XComponent=0, YComponent=0, ZComponent=expression)  # -> Vector, Length
debrep = DeconstructBrep(Brep=rectangle.Rectangle)  # -> Faces, Edges, Vertices
dom_5 = ConstructDomain(DomainStart="-.25", DomainEnd=".25")
dom_6 = ConstructDomain(DomainStart="-1", DomainEnd="1")
extr = Extrude(Base=innerinnerbottom, Direction=vec.Vector)
boundary = BoundarySurfaces(Edges=rectangle.Rectangle)
boundary_2 = BoundarySurfaces(Edges=[cir_3, cir_4])
item = ListItem(List=debrep.Edges, Index=Slider(2, range=0..3), Wrap=True)
loft = Loft(
    Curves=[cir_4, cir_3, cir, cir_2],
    Options={Adjust=False, Closed=True, LoftEnds=0, LoftSimp=0, LoftType=3, Rebuild=10, Refit=0.01})
cap = CapHoles(Brep=extr)

# ---- group: BaseRings / InnerCircleTop
division_2 = Division(A=innercirclediameter, B="2")
addition_6 = Addition(A=division_2, B=innercirclewidth)
innerinnertop = Circle(Plane=pt_2, Radius=division_2)
inneroutertop = Circle(Plane=pt_2, Radius=addition_6)

# ----
divide = DivideCurve(Curve=item, Count="2", Kinks=False)  # -> Points, Tangents, Parameters

# ---- group: BaseRings / OuterCircleTop
addition_7 = Addition(A=addition_6, B=clearance)
addition_8 = Addition(A=addition_7, B=outercirclewdith)
cir_5 = Circle(Plane=pt_2, Radius=addition_7)
cir_6 = Circle(Plane=pt_2, Radius=addition_8)

# ----
item_2 = ListItem(List=divide.Points, Index=Slider(1, range=0..2), Wrap=True)
pdecon_2 = Deconstruct(Point=item_2)  # -> XComponent, YComponent, ZComponent
addition_9 = Addition(A=pdecon_2.ZComponent, B=".125")
pt_6 = ConstructPoint(XCoordinate=pdecon_2.XComponent, YCoordinate=pdecon_2.YComponent, ZCoordinate=addition_9)
pt_7 = ConstructPoint(XCoordinate=0, YCoordinate=0, ZCoordinate=addition_9)

# ---- group: BaseRings / InnerRingNotchCircle
division_3 = Division(A=addition, B="2")
expression_2 = Expression(x=addition_6, y=clearance, z=outercirclewdith, Expression="x - ((y + z)/2)")
pt_8 = ConstructPoint(XCoordinate=pdecon.XComponent, YCoordinate=pdecon.YComponent, ZCoordinate=division_3)
inneroutertop_2 = Circle(Plane=pt_8, Radius=expression_2)

# ----
dom_7 = ConstructDomain(DomainStart="-.1625", DomainEnd=".1625")
dom_8 = ConstructDomain(DomainStart="-.1625", DomainEnd=".1625")
rectangle_3 = Rectangle(Plane=item_2, XSize=dom_7, YSize="-.255", Radius=0)  # -> Rectangle, Length
rectangle_4 = Rectangle(Plane=pt_6, XSize=dom_8, YSize="-.255", Radius=0)  # -> Rectangle, Length
cir_7 = Circle(Plane=pt_7, Radius=addition_4)
division_4 = Division(A=innercirclewidth, B="4")
division_5 = Division(A=baseheight, B="2")

# ---- group: BaseRings / OuterRingNotchCircle
addition_10 = Addition(A=expression_2, B=clearance)
inneroutertop_3 = Circle(Plane=pt_8, Radius=addition_10)

# ----
subtraction_3 = Subtraction(A=division_5, B=".01")
subtraction_4 = Subtraction(A=division_4, B=".005")
flatten = FlattenTree(Tree=cir_7, Path="{0}")
rdiff = RegionDifference(CurvesA=boundary, CurvesB=rectangle_3.Rectangle)

# ---- group: BaseRings / InnerRing
loft_opt = LoftOptions(Closed=Toggle(True), Adjust=False, Rebuild=0, Refit=0, Type="3")
innerringfinal = Loft(Curves=[inneroutertop, innerinnertop, innerinnerbottom, innerouterbottom, inneroutertop_2], Options=loft_opt)

# ---- group: BaseRings / OuterRing
loft_opt_2 = LoftOptions(Closed=Toggle(True), Adjust=False, Rebuild=0, Refit=0, Type="3")
outerringfinal = Loft(Curves=[cir_2, cir, cir_6, cir_5, inneroutertop_3], Options=loft_opt_2)

# ----
vec_2 = VectorXYZ(XComponent=0, YComponent=0, ZComponent=subtraction_3)  # -> Vector, Length

# ---- group: BatteryMount
boundary_3 = BoundarySurfaces(Edges=[rectangle_2.Rectangle, cir_4])
loft_2 = Loft(
    Curves=[rectangle_2.Rectangle, rectangle.Rectangle],
    Options={Adjust=False, Closed=False, LoftEnds=0, LoftSimp=0, LoftType=3, Rebuild=10, Refit=0.01})
boundary_4 = BoundarySurfaces(Edges=rdiff)  # -> flatten(Surfaces)
loft_3 = Loft(
    Curves=[rectangle_3.Rectangle, rectangle_4.Rectangle],
    Options={Adjust=False, Closed=False, LoftEnds=0, LoftSimp=0, LoftType=0, Rebuild=10, Refit=0.01})  # -> flatten(Loft)
boundary_5 = BoundarySurfaces(Edges=[rectangle_4.Rectangle, cir_7])  # -> flatten(Surfaces)
loft_4 = Loft(
    Curves=[cir_4, flatten],
    Options={Adjust=False, Closed=False, LoftEnds=0, LoftSimp=0, LoftType=0, Rebuild=10, Refit=0.01})

# ---- group: HeightPointAdjustment
pdecon_3 = Deconstruct(Point=pt_2)  # -> XComponent, YComponent, ZComponent
addition_11 = Addition(A=pdecon_3.ZComponent, B=spireheight)
pt_9 = ConstructPoint(XCoordinate=pdecon_3.XComponent, YCoordinate=pdecon_3.YComponent, ZCoordinate=addition_11)

# ---- group: BaseRings / AddFillet
number_slider = Slider(1.5, range=0..2)
debrep_2 = DeconstructBrep(Brep=innerringfinal)  # -> Faces, Edges, Vertices
debrep_3 = DeconstructBrep(Brep=outerringfinal)  # -> Faces, Edges, Vertices
filedge = FilletEdge(Shape=outerringfinal, Blend=0, Metric=0, Edges="9", Radii=number_slider)
filedge_2 = FilletEdge(Shape=innerringfinal, Blend=0, Metric=0, Edges="9", Radii=number_slider)

# ----
vec_3 = VectorXYZ(XComponent=0, YComponent=0, ZComponent=".9")  # -> Vector, Length
vec_4 = VectorXYZ(XComponent=0, YComponent=0, ZComponent=".3")  # -> Vector, Length
panel = Panel(filedge_2)
darc = DeconstructArc(Arc=cir_5)  # -> BasePlane, Radius, Angle
darc_2 = DeconstructArc(Arc=cir_6)  # -> BasePlane, Radius, Angle
expression_3 = Expression(x=numberoftweencircles, Expression="x + 1")
panel_2 = Panel(filedge)
darc_3 = DeconstructArc(Arc=innerinnertop)  # -> BasePlane, Radius, Angle
darc_4 = DeconstructArc(Arc=inneroutertop)  # -> BasePlane, Radius, Angle
expression_4 = Expression(x=numberoftweencircles, Expression="x + 1")
addition_12 = Addition(A=baseheight, B=spireheight)
subtraction_5 = Subtraction(A=addition_11, B=addition)
subtraction_6 = Subtraction(A=addition_11, B=addition)
avr = Average(Input=[darc.Radius, darc_2.Radius])

# ---- group: UppInnerRingNotches
cir_8 = Circle(Plane=pt, Radius=avr)
divide_2 = DivideCurve(Curve=cir_8, Count="8", Kinks=False)  # -> Points, Tangents, Parameters
division_6 = Division(A=innercirclewidth, B="4")
division_7 = Division(A=baseheight, B="2")
cir_9 = Circle(Plane=divide_2.Points, Radius=division_6)
vec_5 = VectorXYZ(XComponent=0, YComponent=0, ZComponent=division_7)  # -> Vector, Length
extr_2 = Extrude(Base=cir_9, Direction=vec_5.Vector)
cap_2 = CapHoles(Brep=extr_2)  # -> reverse(Brep)
flatten_2 = FlattenTree(Tree=cap_2, Path="{0}")

# ----
cir_10 = Circle(Plane=divide_2.Points, Radius=subtraction_4)
extr_3 = Extrude(Base=cir_10, Direction=vec_2.Vector)
cap_3 = CapHoles(Brep=extr_3)
flatten_3 = FlattenTree(Tree=cap_3, Path="{0}")
panel_3 = Panel(cap_2)
avr_2 = Average(Input=[darc_3.Radius, darc_4.Radius])
division_8 = Division(A=subtraction_6, B=expression_4)
division_9 = Division(A=addition_12, B=expression_3)
panel_4 = Panel(flatten_2)
division_10 = Division(A=outertwist, B=expression_3)
division_11 = Division(A=innertwist, B=expression_4)
addition_13 = Addition(A=expression_3, B="1")
addition_14 = Addition(A=expression_4, B="1")
series = Series(Start=0, Step=division_9, Count=addition_13)
series_2 = Series(Start=0, Step=division_10, Count=addition_13)
series_3 = Series(Start=addition, Step=division_8, Count=addition_14)
series_4 = Series(Start=0, Step=division_11, Count=addition_14)
pt_10 = ConstructPoint(XCoordinate=0, YCoordinate=0, ZCoordinate=series)
pt_11 = ConstructPoint(XCoordinate=0, YCoordinate=0, ZCoordinate=series_3)
rad = Radians(Degrees=series_2)
rad_2 = Radians(Degrees=series_4)
panel_5 = Panel(series_3)
cir_11 = Circle(Plane=pt_11, Radius=avr_2)
cir_12 = Circle(Plane=pt_10, Radius=avr)
rotate = Rotate(Geometry=cir_12, Angle=rad, Plane=PlaneXY(0, 0, 0))  # -> Geometry, Transform
rotate_2 = Rotate(Geometry=cir_11, Angle=rad_2, Plane=PlaneXY(0, 0, 0))  # -> Geometry, Transform
divide_3 = DivideCurve(Curve=rotate.Geometry, Count=outerspokecount, Kinks=False)  # -> Points, Tangents, Parameters
divide_4 = DivideCurve(Curve=rotate_2.Geometry, Count=innerspokecount, Kinks=False)  # -> Points, Tangents, Parameters
flip = FlipMatrix(Data=divide_3.Points)
flip_2 = FlipMatrix(Data=divide_4.Points)
intcrv = Interpolate(Vertices=flip, Degree=Slider(3, range=0..5), Periodic=False, KnotStyle=1)  # -> Curve, Length, Domain
intcrv_2 = Interpolate(Vertices=flip_2, Degree=Slider(3, range=0..5), Periodic=False, KnotStyle=1)  # -> Curve, Length, Domain
eval = EvaluateCurve(Curve=reparameterize(intcrv.Curve), Parameter="1")  # -> Point, Tangent, Angle
expression_5 = Expression(x=subtraction_5, y=addition, Expression="(x/2) + y")
eval_2 = EvaluateCurve(Curve=reparameterize(intcrv_2.Curve), Parameter="1")  # -> Point, Tangent, Angle
expression_6 = Expression(x=subtraction_6, y=addition, Expression="(x/2) + y")
pl = PlaneNormal(Origin=eval.Point, ZAxis=Vector(0, 0, 1))
vec2pt = Vector2Pt(PointA=eval.Point, PointB=pt_9, Unitize=False)  # -> Vector, Length
pl_2 = PlaneNormal(Origin=eval_2.Point, ZAxis=Vector(0, 0, 1))
vec2pt_2 = Vector2Pt(PointA=eval_2.Point, PointB=pt_9, Unitize=False)  # -> Vector, Length
pt_12 = ConstructPoint(XCoordinate=0, YCoordinate=0, ZCoordinate=expression_5)
pt_13 = ConstructPoint(XCoordinate=0, YCoordinate=0, ZCoordinate=expression_6)
eval_3 = EvaluateCurve(Curve=reparameterize(intcrv.Curve), Parameter=".5")  # -> Point, Tangent, Angle
expression_7 = Expression(x=outercirclewdith, Expression="-x/1")
expression_8 = Expression(x=outerspokethickness, Expression="-x/2")
expression_9 = Expression(x=outercirclewdith, Expression="x/2")
expression_10 = Expression(x=outerspokethickness, Expression="x/2")
eval_4 = EvaluateCurve(Curve=reparameterize(intcrv_2.Curve), Parameter=".5")  # -> Point, Tangent, Angle
expression_11 = Expression(x=innercirclewidth, Expression="-x/2")
expression_12 = Expression(x=innerspokethickness, Expression="-x/2")
eval_5 = EvaluateCurve(Curve=reparameterize(intcrv.Curve), Parameter="0")  # -> Point, Tangent, Angle
expression_13 = Expression(x=innercirclewidth, Expression="x/2")
expression_14 = Expression(x=innerspokethickness, Expression="x/2")
eval_6 = EvaluateCurve(Curve=reparameterize(intcrv_2.Curve), Parameter="0")  # -> Point, Tangent, Angle
align = AlignPlane(Plane=pl, Direction=vec2pt.Vector)  # -> Plane, Angle
align_2 = AlignPlane(Plane=pl_2, Direction=vec2pt_2.Vector)  # -> Plane, Angle
expression_15 = Expression(x=outercirclewdith, Expression="-x/1")
dom_9 = ConstructDomain(DomainStart=expression_7, DomainEnd=expression_9)
expression_16 = Expression(x=outerspokethickness, Expression="-x/2")
dom_10 = ConstructDomain(DomainStart=expression_8, DomainEnd=expression_10)
expression_17 = Expression(x=outercirclewdith, Expression="x/2")
expression_18 = Expression(x=outerspokethickness, Expression="x/2")
expression_19 = Expression(x=innercirclewidth, Expression="-x/2")
dom_11 = ConstructDomain(DomainStart=expression_11, DomainEnd=expression_13)
expression_20 = Expression(x=innerspokethickness, Expression="-x/2")
dom_12 = ConstructDomain(DomainStart=expression_12, DomainEnd=expression_14)
expression_21 = Expression(x=outercirclewdith, Expression="-x/1")
expression_22 = Expression(x=innercirclewidth, Expression="x/2")
expression_23 = Expression(x=outerspokethickness, Expression="-x/2")
expression_24 = Expression(x=innerspokethickness, Expression="x/2")
expression_25 = Expression(x=outercirclewdith, Expression="x/2")
expression_26 = Expression(x=outerspokethickness, Expression="x/2")
expression_27 = Expression(x=innercirclewidth, Expression="-x/2")
expression_28 = Expression(x=innerspokethickness, Expression="-x/2")
expression_29 = Expression(x=innercirclewidth, Expression="x/2")
expression_30 = Expression(x=innerspokethickness, Expression="x/2")
vec2pt_3 = Vector2Pt(PointA=eval_3.Point, PointB=pt_12, Unitize=False)  # -> Vector, Length
pl_3 = PlaneNormal(Origin=eval_3.Point, ZAxis=Vector(0, 0, 1))
vec2pt_4 = Vector2Pt(PointA=eval_4.Point, PointB=pt_13, Unitize=False)  # -> Vector, Length
pl_4 = PlaneNormal(Origin=eval_4.Point, ZAxis=Vector(0, 0, 1))
vec2pt_5 = Vector2Pt(PointA=eval_5.Point, PointB=pt_2, Unitize=False)  # -> Vector, Length
pl_5 = PlaneNormal(Origin=eval_5.Point, ZAxis=Vector(0, 0, 1))
vec2pt_6 = Vector2Pt(PointA=eval_6.Point, PointB=pt_2, Unitize=False)  # -> Vector, Length
pl_6 = PlaneNormal(Origin=eval_6.Point, ZAxis=Vector(0, 0, 1))
rectangle_5 = Rectangle(Plane=align.Plane, XSize=dom_9, YSize=dom_10, Radius=0)  # -> Rectangle, Length
dom_13 = ConstructDomain(DomainStart=expression_15, DomainEnd=expression_17)
dom_14 = ConstructDomain(DomainStart=expression_16, DomainEnd=expression_18)
rectangle_6 = Rectangle(Plane=align_2.Plane, XSize=dom_11, YSize=dom_12, Radius=0)  # -> Rectangle, Length
dom_15 = ConstructDomain(DomainStart=expression_19, DomainEnd=expression_22)
dom_16 = ConstructDomain(DomainStart=expression_20, DomainEnd=expression_24)
dom_17 = ConstructDomain(DomainStart=expression_21, DomainEnd=expression_25)
dom_18 = ConstructDomain(DomainStart=expression_23, DomainEnd=expression_26)
dom_19 = ConstructDomain(DomainStart=expression_27, DomainEnd=expression_29)
dom_20 = ConstructDomain(DomainStart=expression_28, DomainEnd=expression_30)
divide_5 = DivideCurve(Curve=cir_12, Count=outerspokecount, Kinks=False)  # -> Points, Tangents, Parameters
graft = GraftTree(Tree=rectangle_5.Rectangle, IncludeEmptyLists=True, IncludeNullItems=True)
graft_2 = GraftTree(Tree=rectangle_6.Rectangle, IncludeEmptyLists=True, IncludeNullItems=True)
align_3 = AlignPlane(Plane=pl_3, Direction=vec2pt_3.Vector)  # -> Plane, Angle
rectangle_7 = Rectangle(Plane=align_3.Plane, XSize=dom_13, YSize=dom_14, Radius=0)  # -> Rectangle, Length
align_4 = AlignPlane(Plane=pl_4, Direction=vec2pt_4.Vector)  # -> Plane, Angle
rectangle_8 = Rectangle(Plane=align_4.Plane, XSize=dom_15, YSize=dom_16, Radius=0)  # -> Rectangle, Length
align_5 = AlignPlane(Plane=pl_5, Direction=vec2pt_5.Vector)  # -> Plane, Angle
rectangle_9 = Rectangle(Plane=align_5.Plane, XSize=dom_17, YSize=dom_18, Radius=0)  # -> Rectangle, Length
align_6 = AlignPlane(Plane=pl_6, Direction=vec2pt_6.Vector)  # -> Plane, Angle
rectangle_10 = Rectangle(Plane=align_6.Plane, XSize=dom_19, YSize=dom_20, Radius=0)  # -> Rectangle, Length
flip_3 = FlipMatrix(Data=divide_5.Points)
graft_3 = GraftTree(Tree=rectangle_7.Rectangle, IncludeEmptyLists=True, IncludeNullItems=True)
graft_4 = GraftTree(Tree=rectangle_8.Rectangle, IncludeEmptyLists=True, IncludeNullItems=True)
graft_5 = GraftTree(Tree=rectangle_9.Rectangle, IncludeEmptyLists=True, IncludeNullItems=True)
graft_6 = GraftTree(Tree=rectangle_10.Rectangle, IncludeEmptyLists=True, IncludeNullItems=True)

# ---- group: Verticals
divide_6 = DivideCurve(Curve=cir_11, Count=innerspokecount, Kinks=False)  # -> Points, Tangents, Parameters
flip_4 = FlipMatrix(Data=divide_6.Points)
pline = PolyLine(Vertices=flip_4, Closed=False)
swp1 = Sweep1(Rail=pline, Sections=graft_6, Miter=1)

# ----
expression_31 = Expression(x=outerspokecount, Expression="(360/(x*2))")
pline_2 = PolyLine(Vertices=flip_3, Closed=False)
mod = Modulus(A=outerspokecount, B="2")
swp1_2 = Sweep1(Rail=intcrv.Curve, Sections=[graft, graft_5, graft_3], Miter=1)
swp1_3 = Sweep1(Rail=intcrv_2.Curve, Sections=[graft_2, graft_6, graft_4], Miter=1)
expression_32 = Expression(y=mod, z=expression_31, Expression="if(y = 0, 0, z) ")
swp1_4 = Sweep1(Rail=pline_2, Sections=graft_5, Miter=1)
cap_4 = CapHoles(Brep=swp1_2)
expression_33 = Expression(x=addition_5, Expression="-x - 1")
expression_34 = Expression(x=addition_5, Expression="x + 1")
cap_5 = CapHoles(Brep=swp1_3)
cap_6 = CapHoles(Brep=swp1_4)
mirror = Mirror(Geometry=cap_4, Plane=PlaneYZ(0, 0, 0))  # -> Geometry, Transform
rad_3 = Radians(Degrees=expression_32)
dom_21 = ConstructDomain(DomainStart=expression_33, DomainEnd=expression_34)
rotate_3 = Rotate(Geometry=mirror.Geometry, Angle=rad_3, Plane=PlaneXY(0, 0, 0))  # -> Geometry, Transform
planesrf = PlaneSurface(Plane=pt_3, XSize=dom_21, YSize=dom_21)
cap_7 = CapHoles(Brep=swp1)
xy = XYPlane(Origin=Point(0, 0, 0))
mirror_2 = Mirror(Geometry=[cap_6, rotate_3.Geometry], Plane=xy)  # -> Geometry, Transform
flatten_4 = FlattenTree(Tree=cap_6, Path="{0}")
flatten_5 = FlattenTree(Tree=cap_4, Path="{0}")
cap_8 = CapHoles(Brep=flatten_4)  # -> graft(Brep)
cap_9 = CapHoles(Brep=flatten_5)  # -> graft(Brep)
# Lower Outer Wall
sunion = SolidUnion(Breps=[flatten_3, loft])
# Lower Ribs
splitmul = SplitBrepMultiple(Brep=mirror_2.Geometry, Cutters=planesrf)
# Lower Battery Mount
bvol = BoundaryVolume(Boundaries=[boundary_3, loft_2, boundary_4, loft_3, boundary_5, loft_4])
sunion_2 = SolidUnion(Breps=[filedge, cap_9, cap_8])
# Upper Inner Spokes
flatten_6 = FlattenTree(Tree=cap_7, Path="{0}")
# Upper Inner Twists
flatten_7 = FlattenTree(Tree=cap_5, Path="{0}")
# Upper Outer
sdiff = SolidDifference(BrepsA=sunion_2, BrepsB=flatten_2)
panel_6 = Panel(sdiff)
panel_7 = Panel(sunion_2)

# ---- group: EngineMountStuff
pt_14 = Point(pt_7)
pdecon_4 = Deconstruct(Point=pt_14)  # -> XComponent, YComponent, ZComponent
pdecon_5 = Deconstruct(Point=pt_14)  # -> XComponent, YComponent, ZComponent
subtraction_7 = Subtraction(A=pdecon_4.YComponent, B="0.2998543")
pt_15 = ConstructPoint(XCoordinate=pdecon_5.XComponent, YCoordinate=pdecon_5.YComponent, ZCoordinate=pdecon_5.ZComponent)
pt_16 = ConstructPoint(XCoordinate=pdecon_4.XComponent, YCoordinate=subtraction_7, ZCoordinate=pdecon_4.ZComponent)
pdecon_6 = Deconstruct(Point=pt_15)  # -> XComponent, YComponent, ZComponent
cir_13 = Circle(Plane=pt_16, Radius="1.87/2")
cir_14 = Circle(Plane=pt_16, Radius="1.324/2")
addition_15 = Addition(A=pdecon_6.ZComponent, B="1.19")
pt_17 = ConstructPoint(XCoordinate=pdecon_6.XComponent, YCoordinate=pdecon_6.YComponent, ZCoordinate=addition_15)
pdecon_7 = Deconstruct(Point=pt_17)  # -> XComponent, YComponent, ZComponent
addition_16 = Addition(A=pdecon_7.XComponent, B=".08")
addition_17 = Addition(A=pdecon_7.XComponent, B="-.08")
cir_15 = Circle(Plane=pt_17, Radius=".1")
pt_18 = ConstructPoint(XCoordinate=addition_16, YCoordinate=pdecon_7.YComponent, ZCoordinate=pdecon_7.ZComponent)
pt_19 = ConstructPoint(XCoordinate=addition_17, YCoordinate=pdecon_7.YComponent, ZCoordinate=pdecon_7.ZComponent)
dom_22 = ConstructDomain(DomainStart="-0.0984252", DomainEnd="0.0984252")
rectangle_11 = Rectangle(Plane=pt_18, XSize=".08", YSize=dom_22, Radius=0)  # -> Rectangle, Length
rectangle_12 = Rectangle(Plane=pt_19, XSize="-.08", YSize=dom_22, Radius=0)  # -> Rectangle, Length
rdiff_2 = RegionDifference(CurvesA=cir_15, CurvesB=[rectangle_11.Rectangle, rectangle_12.Rectangle])
pdecon_8 = Deconstruct(Point=pt_16)  # -> XComponent, YComponent, ZComponent
addition_18 = Addition(A=pdecon_8.ZComponent, B=".9")
pt_20 = ConstructPoint(XCoordinate=pdecon_8.XComponent, YCoordinate=pdecon_8.YComponent, ZCoordinate=addition_18)
cir_16 = Circle(Plane=pt_20, Radius="0.7677165")
divide_7 = DivideCurve(Curve=cir_16, Count="2", Kinks=False)  # -> Points, Tangents, Parameters
cir_17 = Circle(Plane=divide_7.Points, Radius=".123/2")
vec_6 = VectorXYZ(XComponent=0, YComponent=0, ZComponent="-.375")  # -> Vector, Length
extr_4 = Extrude(Base=cir_17, Direction=vec_6.Vector)
cap_10 = CapHoles(Brep=extr_4)

# ----
rectangle_13 = Rectangle(Plane=pt_16, XSize=dom_5, YSize=dom_6, Radius=0)  # -> flatten(Rectangle), Length
rdiff_3 = RegionDifference(CurvesA=[cir_13, cir_14], CurvesB=rectangle_13.Rectangle)

item_3 = ListItem(List=rdiff_3, Index=Slider(0, range=0..3), Wrap=True)
item_4 = ListItem(List=rdiff_3, Index=Slider(2, range=0..3), Wrap=True)
item_5 = ListItem(List=rdiff_3, Index=Slider(1, range=0..3), Wrap=True)
item_6 = ListItem(List=rdiff_3, Index=Slider(3, range=0..3), Wrap=True)
rdiff_4 = RegionDifference(CurvesA=item_3, CurvesB=item_4)
rdiff_5 = RegionDifference(CurvesA=item_5, CurvesB=item_6)

extr_5 = Extrude(Base=rdiff_2, Direction=vec_4.Vector)
cap_11 = CapHoles(Brep=extr_5)  # -> flatten(Brep)
sdiff_2 = SolidDifference(BrepsA=cap, BrepsB=cap_11)
# Upper Inner Base
sunion_3 = SolidUnion(Breps=[filedge_2, sdiff_2])

# ---- group: EngineMountStuff (continued)
extr_6 = Extrude(Base=[rdiff_4, rdiff_5], Direction=vec_3.Vector)

# ----
cap_12 = CapHoles(Brep=extr_6)

# ---- group: EngineMountStuff (continued)
sunion_4 = SolidUnion(Breps=cap_12)

# ----
# Lower Engine Mount
sdiff_3 = SolidDifference(BrepsA=sunion_4, BrepsB=cap_10)
