# Grasshopper definition moire_spheres_v1.gh (Grasshopper 1.0.8)

# ---- group: InnerOuterStructure
# First Disk
# Don't Touch
# Inner & Outer Walls
pt = Point(<point referenced from the Rhino model>)
panel = Panel("4.25")
cir = Circle(Plane=pt, Radius=".05")
cir_2 = Circle(Plane=pt, Radius=".25")
cir_3 = Circle(Plane=pt, Radius="4")
cir_4 = Circle(Plane=pt, Radius=panel)
boundary = BoundarySurfaces(Edges=[cir, cir_2])
boundary_2 = BoundarySurfaces(Edges=[cir_3, cir_4])
panel_2 = Panel(".25")
Z = UnitZ(Factor=".5")
Z_2 = UnitZ(Factor=panel_2)
extr = Extrude(Base=boundary, Direction=Z)
extr_2 = Extrude(Base=boundary_2, Direction=Z_2)

# ---- group: Spokes / Inputs
numberofspokes = Slider(45, range=0..50)
curvepoints = Slider(5, range=0..12)
startingdirection = Slider(1, range=0..1)
number_slider = Slider(1, range=1..2)
curvecomplexity = Slider(3, range=1..5)

numberofspokes_2 = Slider(35, range=0..50)
curvepoints_2 = Slider(8, range=0..12)
startingdirection_2 = Slider(0, range=0..1)
number_slider_2 = Slider(1, range=1..2)
curvecomplexity_2 = Slider(4, range=1..5)

# ----
expression = Expression(x=panel, Expression="(x*2) + 1")

# ---- group: Spokes / BaseCurves
divide = DivideCurve(Curve=cir_2, Count=numberofspokes, Kinks=False)  # -> Points, Tangents, Parameters
divide_2 = DivideCurve(Curve=cir_3, Count=numberofspokes, Kinks=False)  # -> Points, Tangents, Parameters

# ---- group: Spokes / AdjustedStartingPts
expression_2 = Expression(x=panel_2, Expression="x/2")
expression_3 = Expression(x=panel_2, Expression="x/2")
pdecon = Deconstruct(Point=divide.Points)  # -> XComponent, YComponent, ZComponent
pdecon_2 = Deconstruct(Point=divide_2.Points)  # -> XComponent, YComponent, ZComponent
addition = Addition(A=pdecon.ZComponent, B=expression_2)
addition_2 = Addition(A=pdecon_2.ZComponent, B=expression_3)
pt_2 = ConstructPoint(XCoordinate=pdecon.XComponent, YCoordinate=pdecon.YComponent, ZCoordinate=addition)
pt_3 = ConstructPoint(XCoordinate=pdecon_2.XComponent, YCoordinate=pdecon_2.YComponent, ZCoordinate=addition_2)

# ---- group: Spokes / ZigZagSeries
series = Series(Start=startingdirection_2, Step=number_slider_2, Count=curvepoints_2)
expression_4 = Expression(x=series, Expression="(-1)^x")
replace = ReplaceItems(List=expression_4, Item="0", Indices="0", Wrap=False)

series_2 = Series(Start=startingdirection, Step=number_slider, Count=curvepoints)
expression_5 = Expression(x=series_2, Expression="(-1)^x")
replace_2 = ReplaceItems(List=expression_5, Item="0", Indices="0", Wrap=False)

# ---- group: Spokes / MainSpokes
ln = Line(StartPoint=pt_2, EndPoint=pt_3)
divide_3 = DivideCurve(Curve=ln, Count=curvepoints, Kinks=False)  # -> Points, Tangents, Parameters

# ---- group: Spokes / CurveOffset
expression_6 = Expression(Expression="π/2")
Z_3 = UnitZ(Factor=1)
vrot = Rotate(Vector=divide_3.Tangents, Axis=Z_3, Angle=expression_6)
amp = Amplitude(Vector=vrot, Amplitude=replace_2)
move = Move(Geometry=divide_3.Points, Motion=amp)  # -> Geometry, Transform
nurbs = NurbsCurve(Vertices=move.Geometry, Degree=curvecomplexity, Periodic=False)  # -> Curve, Length, Domain

# ---- group: Spokes / FinalSweep
eval = EvaluateCurve(Curve=nurbs.Curve, Parameter="0")  # -> Point, Tangent, Angle
expression_7 = Expression(x=panel_2, Expression="-x/4")
expression_8 = Expression(x=panel_2, Expression="-x/2")
expression_9 = Expression(x=panel_2, Expression="x/4")
expression_10 = Expression(x=panel_2, Expression="x/2")
pl = PlaneNormal(Origin=eval.Point, ZAxis=eval.Tangent)
dom = ConstructDomain(DomainStart=expression_8, DomainEnd=expression_10)
dom_2 = ConstructDomain(DomainStart=expression_7, DomainEnd=expression_9)
rectangle = Rectangle(Plane=pl, XSize=dom_2, YSize=dom, Radius=0)  # -> Rectangle, Length
graft = GraftTree(Tree=rectangle.Rectangle, IncludeEmptyLists=True, IncludeNullItems=True)
swp1 = Sweep1(Rail=nurbs.Curve, Sections=graft, Miter=1)
cap = CapHoles(Brep=swp1)

# ---- group: Spokes
# FinalBrep
# Only Adjust the Above Values
sunion = SolidUnion(Breps=[extr, extr_2, cap])

# ---- group: InnerOuterStructure
# Second Disk
# Don't Touch
# Inner & Outer Walls
pt_4 = Point(<point referenced from the Rhino model>)
panel_3 = Panel(".25")
Z_4 = UnitZ(Factor=".5")
Z_5 = UnitZ(Factor=panel_3)

# ----
pdecon_3 = Deconstruct(Point=pt_4)  # -> XComponent, YComponent, ZComponent
pt_5 = ConstructPoint(XCoordinate=expression, YCoordinate=pdecon_3.YComponent, ZCoordinate=pdecon_3.ZComponent)

# ---- group: InnerOuterStructure (continued)
cir_5 = Circle(Plane=pt_5, Radius=".05")
cir_6 = Circle(Plane=pt_5, Radius=".25")
cir_7 = Circle(Plane=pt_5, Radius="4")
cir_8 = Circle(Plane=pt_5, Radius="4.25")
boundary_3 = BoundarySurfaces(Edges=[cir_5, cir_6])
boundary_4 = BoundarySurfaces(Edges=[cir_7, cir_8])
extr_3 = Extrude(Base=boundary_3, Direction=Z_4)
extr_4 = Extrude(Base=boundary_4, Direction=Z_5)

# ---- group: Spokes / BaseCurves
divide_4 = DivideCurve(Curve=cir_6, Count=numberofspokes_2, Kinks=False)  # -> Points, Tangents, Parameters
divide_5 = DivideCurve(Curve=cir_7, Count=numberofspokes_2, Kinks=False)  # -> Points, Tangents, Parameters

# ---- group: Spokes / AdjustedStartingPts
expression_11 = Expression(x=panel_3, Expression="x/2")
expression_12 = Expression(x=panel_3, Expression="x/2")
pdecon_4 = Deconstruct(Point=divide_4.Points)  # -> XComponent, YComponent, ZComponent
pdecon_5 = Deconstruct(Point=divide_5.Points)  # -> XComponent, YComponent, ZComponent
addition_3 = Addition(A=pdecon_4.ZComponent, B=expression_11)
addition_4 = Addition(A=pdecon_5.ZComponent, B=expression_12)
pt_6 = ConstructPoint(XCoordinate=pdecon_4.XComponent, YCoordinate=pdecon_4.YComponent, ZCoordinate=addition_3)
pt_7 = ConstructPoint(XCoordinate=pdecon_5.XComponent, YCoordinate=pdecon_5.YComponent, ZCoordinate=addition_4)

# ---- group: Spokes / MainSpokes
ln_2 = Line(StartPoint=pt_6, EndPoint=pt_7)
divide_6 = DivideCurve(Curve=ln_2, Count=curvepoints_2, Kinks=False)  # -> Points, Tangents, Parameters

# ---- group: Spokes / CurveOffset
expression_13 = Expression(Expression="π/2")
Z_6 = UnitZ(Factor=1)
vrot_2 = Rotate(Vector=divide_6.Tangents, Axis=Z_6, Angle=expression_13)
amp_2 = Amplitude(Vector=vrot_2, Amplitude=replace)
move_2 = Move(Geometry=divide_6.Points, Motion=amp_2)  # -> Geometry, Transform
nurbs_2 = NurbsCurve(Vertices=move_2.Geometry, Degree=curvecomplexity_2, Periodic=False)  # -> Curve, Length, Domain

# ---- group: Spokes / FinalSweep
eval_2 = EvaluateCurve(Curve=nurbs_2.Curve, Parameter="0")  # -> Point, Tangent, Angle
expression_14 = Expression(x=panel_3, Expression="-x/2")
expression_15 = Expression(x=panel_3, Expression="-x/4")
expression_16 = Expression(x=panel_3, Expression="x/2")
expression_17 = Expression(x=panel_3, Expression="x/4")
pl_2 = PlaneNormal(Origin=eval_2.Point, ZAxis=eval_2.Tangent)
dom_3 = ConstructDomain(DomainStart=expression_14, DomainEnd=expression_16)
dom_4 = ConstructDomain(DomainStart=expression_15, DomainEnd=expression_17)
rectangle_2 = Rectangle(Plane=pl_2, XSize=dom_4, YSize=dom_3, Radius=0)  # -> Rectangle, Length
graft_2 = GraftTree(Tree=rectangle_2.Rectangle, IncludeEmptyLists=True, IncludeNullItems=True)
swp1_2 = Sweep1(Rail=nurbs_2.Curve, Sections=graft_2, Miter=1)
cap_2 = CapHoles(Brep=swp1_2)

# ---- group: Spokes
# FinalBrep
# Only Adjust the Above Values
sunion_2 = SolidUnion(Breps=[extr_3, extr_4, cap_2])

# ---- group: RotationMoirePreview
# <- Enable Preview
# Slide This to View the Rotation Preview ->
neg = Negative(Value=expression)
vec = VectorXYZ(XComponent=neg, YComponent=pdecon_3.YComponent, ZComponent=pdecon_3.ZComponent)  # -> Vector, Length
move_3 = Move(Geometry=sunion_2, Motion=vec.Vector)  # -> Geometry, Transform
expression_18 = Expression(Expression="1*π")
xz = XZPlane(Origin=Point(0, 0, 0))
rotate = Rotate(Geometry=move_3.Geometry, Angle=expression_18, Plane=xz)  # -> Geometry, Transform
rad = Radians(Degrees=Slider(360, range=0..360))
rotate_2 = Rotate(Geometry=rotate.Geometry, Angle=rad, Plane=PlaneXY(0, 0, 0))  # -> Geometry, Transform
